% Simulink data dictionary CANLights.sldd

dt_SteeringWheel = Simulink.NumericType(DataTypeMode="Fixed-point: slope and bias scaling", SignednessBool=false, WordLength=8, FixedExponent=0, Bias=-128)
SteeringWheelPositionThresholdOn = Simulink.Parameter(25, DataType="int8", Unit="deg")
ConfigSet = Simulink.ConfigSet(StartTime="0", StopTime="10", FixedStep=".005", Solver="FixedStepDiscrete", ProdHWDeviceType="Atmel->AVR", SystemTargetFile="ert.tlc", HardwareBoard="Arduino Uno", TargetLang="C")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
SteeringWheelPositionThresholdOff = Simulink.Parameter(15, DataType="int8", Unit="deg")

en_TurnSignal = enum(DefaultValue="SignalOff", StorageType="uint8")  % Enumeration of turn signal status
  SignalOff = 0  % Turn signal is off
  SignalLeft = 1  % Left turn signal is on
  SignalRight = 2  % Right turn signal is on